# Grasshopper definition kangaroo.gh (Grasshopper 1.0.7)
# plug-ins: Kangaroo2 Components

seed = Slider(13, range=1..30)
surface = Surface(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)
seed_2 = GetNumber(seed, AtLeast=1, AtMost=2147483647, Maximum=1.797693135e+308, Minimum=-1.797693135e+308)
length = GetNumber(Slider(1, range=0..1), AtLeast=1, AtMost=2147483647, Maximum=1.797693135e+308, Minimum=-1.797693135e+308)
strength = GetNumber(Slider(16, range=1..30), AtLeast=1, AtMost=2147483647, Maximum=1.797693135e+308, Minimum=-1.797693135e+308)
iterations = GetNumber(Slider(921, range=0..1000), AtLeast=1, AtMost=2147483647, Maximum=1.797693135e+308, Minimum=-1.797693135e+308)
unit_z = UnitZ(Factor=Slider(17, range=1..100))
extrude = Extrude(Base=surface, Direction=unit_z)
move = Move(Geometry=extrude, Motion=Vector(0, 0, 10))  # -> Geometry, Transform
number_slider = Slider(20, range=0..100)
panel = Panel("""0
1
2""")
number_slider_2 = Slider(2.8, range=0..10)
populate_3d = Populate3D(Region=move.Geometry, Count=100, Seed=seed_2)
area = Area(Geometry=surface)  # -> Area, Centroid
list_item = ListItem(List=populate_3d, Index=panel, Wrap=True)
mesh_surface = MeshSurface(Surface=surface, UCount=number_slider, VCount=number_slider, Overhang=True, Equalize=False)
point = Point(list_item)
point_2 = Point([Point(-11.26745289, 7.464670571, 0), Point(1.582547305, 9.528145827, 0), Point(3.724214003, -9.043131476, 0)])
deconstruct_brep = DeconstructBrep(Brep=surface)  # -> Faces, Edges, Vertices
scale_nu = ScaleNU(Geometry=surface, Plane=area.Centroid, ScaleX=number_slider_2, ScaleY=number_slider_2, ScaleZ=1)  # -> Geometry, Transform
edgelengths = EdgeLengths(Mesh=mesh_surface, LengthFactor=length, Strength=strength)
anchor = Anchor(Point=deconstruct_brep.Vertices, Strength=10000)
vertexloads = VertexLoads(Mesh=mesh_surface, Strength=-0.1)
anchor_2 = Anchor(Point=point_2, Target=point, Strength=10000)
show = Show(G=mesh_surface)
zombiesolver = ZombieSolver(
    GoalObjects=flatten([show, edgelengths, anchor, vertexloads, anchor_2]),
    Threshold=1e-10,
    Tolerance=0.01,
    MaxIterations=iterations)  # -> I, V, O
list_item_2 = ListItem(List=zombiesolver.O, Index=0, Wrap=True)  # -> Item, Item1

panel_2 = Panel("http://climate.onebuilding.org/WMO_Region_4_North_and_Central_America/USA_United_States_of_America/WI_Wisconsin/USA_WI_Madison-Dane.County.Rgnl.AP-Truax.Field.726410_TMY3.zip")
downloadepw = LBDownloadWeather(weather_URL=panel_2)  # -> epw_file, stat_file, ddy_file; plug-in component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
importloc = LBImportLocation(epw_file=downloadepw.epw_file)  # -> location; plug-in component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

geometry = Geometry(zombiesolver.O)
mesh_edges = MeshEdges(Mesh=list_item_2.Item)  # -> NakedEdges, InteriorEdges, NonManifoldEdges
deconstruct_mesh = DeconstructMesh(Mesh=list_item_2.Item)  # -> Vertices, Faces, Colours, Normals

analysisperiod = LBAnalysisPeriod(start_month="6", start_day="21", start_hour=0, end_month="6", end_day="21", end_hour=23, timestep="1")  # -> period, hoys, dates; plug-in component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

list_length = ListLength(List=deconstruct_mesh.Faces)
dash_pattern = DashPattern(Curve=mesh_edges.InteriorEdges, Pattern=Slider(0.4, range=0.1..2))  # -> Dashes, Gaps
curve = Curve(mesh_edges.NakedEdges)
series = Series(Start=0, Step=1, Count=list_length)  # -> simplify(Series)
gradient = Gradient(LowerLimit=0, UpperLimit=list_length, Parameter=series, stops=[0: RGB(255, 130, 160), 1: RGB(0, 99, 177)])
colrange = LBColorRange(index=Slider(22, range=0..25))  # -> colors; plug-in component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

sunpath = LBSunPath(north="20", location=importloc, hoys=analysisperiod.hoys, scale=1)  # -> report, vectors, altitudes, azimuths, hoys, sun_pts, analemma, daily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; plug-in component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

legendpar = LBLegendParameters(colors=colrange)  # -> leg_par; plug-in component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

# ---- group: Run Me!
toggle = BooleanToggle(True)

# ----
directsunhours = LBDirectSunHours(
    vectors=flatten(sunpath.vectors),
    timestep="1",
    geometry=flatten(scale_nu.Geometry),
    context=flatten(list_item_2.Item),
    grid_size="2",
    offset_dist="0.1",
    legend_par=legendpar,
    run=toggle)  # -> report, points, results, mesh, legend, title, int_mtx; plug-in component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

mesh_colours = MeshColours(Mesh=list_item_2.Item, Colours=gradient)

# ---- group: RH_OUT:curveskangar
curve_2 = Curve([curve, dash_pattern.Dashes])

# ---- group: RH_OUT:mesh
mesh = Mesh(directsunhours.mesh)

# ---- group: RH_OUT:ground
groundmesh = Mesh(mesh_colours)
