# Grasshopper definition lunarc.gh (Grasshopper 1.0.7)
# plug-ins: Heteroptera, MeshEdit Components

# PART C  //  2 PERSON VERTICAL
# + PART DEFINITION
brep = Brep(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)
brep_2 = Brep(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)
brep_3 = Brep(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)
# PART G  // COMMUNAL
# + PART DEFINITION
part_h_geom = Geometry(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)
pt = Point([Point(-2431.966297, -76.98006532, 14.10000024), Point(-2431.966297, -76.98006532, 9.900000174), Point(-2431.966297, -76.98006532, 5.700000105), Point(-2425.823823, -76.88051672, 14.10000024), Point(-2425.823823, -76.88206297, 9.900000174), Point(-2425.823823, -76.88206297, 5.700000105)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])
crv = Curve([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])
pt_2 = Point([Point(-2431.96707, -74.70179702, 2.523478969), Point(-2425.824597, -73.37475192, 2.523478969), Point(-2430.006868, -67.15623884, 2.523478969)])
crv_2 = Curve([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])
# PART B  //  2 PERSON
# + PART DEFINITION
data = Data(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)
# PART E  // STRUCTURE
# + PART DEFINITION
part_h_geom_2 = Geometry(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)
crv_3 = Curve(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)
# PART F  // COLUMN
# + PART DEFINITION
part_j_geom = Geometry(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)
pt_3 = Point(Point(-2489.972742, -77.29473444, 0))
# LIVING PARTS
# PART A  //  4 PERSON
# + PART DEFINITION
brep_4 = Brep(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)
crv_4 = Curve(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)
pt_4 = Point([Point(-2560.972738, -75.32748777, 0), Point(-2558.272738, -72.62748777, 0), Point(-2555.572738, -75.32748777, 0), Point(-2558.272738, -78.02748777, 0), Point(-2558.272738, -75.32748777, 1.5)])
pt_5 = Point(Point(-2558.272738, -75.32748777, -2.7))
crv_5 = Curve([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])
pt_6 = Point(Point(-2516.737731, -75.73048769, 0))
conndir = Wasp_ConnectionFromDirection(GEO=brep, CEN=pt_4, UP=crv_5, T="2PER_V-SID")  # -> CONN, PLN_OUT; inputs CEN: list of Point3d, UP: list of Curve, T: list; plug-in component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
crv_6 = Curve(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)
conndir_2 = Wasp_ConnectionFromDirection(GEO=brep, CEN=pt_5, UP=crv_4, T="2PER_V-FRO")  # -> CONN, PLN_OUT; inputs CEN: list of Point3d, UP: list of Curve, T: list; plug-in component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
crv_7 = Curve(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)
pt_7 = Point(Point(-2519.787731, -75.73048769, 3.05))
crv_8 = Curve(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)
pt_8 = Point(Point(-2538.370478, -75.73048769, 2.7))
attribute = Wasp_Attribute(ID="LADYBUG", VAL=brep, TR=Toggle(True))  # -> ATTR; inputs VAL: list, TR: Boolean; plug-in component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
crv_9 = Curve(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)
pt_9 = Point(Point(-2519.787731, -72.68048769, 0))
pt_10 = Point(Point(-2532.671078, -75.73048769, 0))
crv_10 = Curve(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)
crv_11 = Curve(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)
pt_11 = Point(Point(-2538.370478, -73.03048769, 0))
point = Point(Point(-2521.287731, -75.73048769, 0))
curve = Curve(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)
pt_12 = Point(Point(-2451.537057, -75.48048769, 4))
crv_12 = Curve(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)
brep_5 = Brep(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)
conndir_3 = Wasp_ConnectionFromDirection(GEO=part_j_geom, CEN=pt_12, UP=crv_12, T="COL-TOP")  # -> CONN, PLN_OUT; inputs CEN: list of Point3d, UP: list of Curve, T: list; plug-in component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
conndir_4 = Wasp_ConnectionFromDirection(GEO=data, CEN=pt_7, UP=crv_11, T="2PER-TOP")  # -> CONN, PLN_OUT; inputs CEN: list of Point3d, UP: list of Curve, T: list; plug-in component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
conndir_5 = Wasp_ConnectionFromDirection(GEO=data, CEN=pt_9, UP=crv_8, T="2PER-SID")  # -> CONN, PLN_OUT; inputs CEN: list of Point3d, UP: list of Curve, T: list; plug-in component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
conndir_6 = Wasp_ConnectionFromDirection(GEO=brep_4, CEN=pt_10, UP=crv_9, T="4PER-FRO")  # -> CONN, PLN_OUT; inputs CEN: list of Point3d, UP: list of Curve, T: list; plug-in component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
conndir_7 = Wasp_ConnectionFromDirection(GEO=data, CEN=point, UP=curve, T="2PER-STR")  # -> CONN, PLN_OUT; inputs CEN: list of Point3d, UP: list of Curve, T: list; plug-in component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
conndir_8 = Wasp_ConnectionFromDirection(GEO=data, CEN=pt_6, UP=crv_6, T="2PER-FRO")  # -> CONN, PLN_OUT; inputs CEN: list of Point3d, UP: list of Curve, T: list; plug-in component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
conndir_9 = Wasp_ConnectionFromDirection(GEO=brep_4, CEN=pt_8, UP=crv_7, T="4PER-TOP")  # -> CONN, PLN_OUT; inputs CEN: list of Point3d, UP: list of Curve, T: list; plug-in component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
conndir_10 = Wasp_ConnectionFromDirection(GEO=brep_4, CEN=pt_11, UP=crv_10, T="4PER-SID")  # -> CONN, PLN_OUT; inputs CEN: list of Point3d, UP: list of Curve, T: list; plug-in component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
attribute_2 = Wasp_Attribute(ID="LADYBUG", VAL=brep_5, TR=Toggle(True))  # -> ATTR; inputs VAL: list, TR: Boolean; plug-in component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
attribute_3 = Wasp_Attribute(ID="LADYBUG", VAL=data, TR=Toggle(True))  # -> ATTR; inputs VAL: list, TR: Boolean; plug-in component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
attribute_4 = Wasp_Attribute(ID="LADYBUG", VAL=brep_4, TR=Toggle(True))  # -> ATTR; inputs VAL: list, TR: Boolean; plug-in component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
attribute_5 = Wasp_Attribute(ID="LADYBUG", VAL=brep_3, TR=Toggle(True))  # -> ATTR; inputs VAL: list, TR: Boolean; plug-in component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
conndir_11 = Wasp_ConnectionFromDirection(GEO=part_h_geom_2, CEN=pt_3, UP=crv_3, T="ST-FRO")  # -> CONN, PLN_OUT; inputs CEN: list of Point3d, UP: list of Curve, T: list; plug-in component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
seed_reset = Slider(21, range=0..100)
advpart = Wasp_AdvancedPart(NAME="2PER_V", GEO=brep, CONN=flatten([conndir_2.CONN, conndir.CONN]), ATTR=flatten(attribute))  # -> PART; inputs GEO: Mesh, CONN: list, HI: list, ATTR: list, SUP: list, AEC: list, OC: list; plug-in component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
attribute_6 = Wasp_Attribute(ID="LADYBUG", VAL=part_h_geom_2, TR=Toggle(True))  # -> ATTR; inputs VAL: list, TR: Boolean; plug-in component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
start_hour = Slider(1, range=1..23)
end_hour = Slider(23, range=1..23)
month = Slider(1, range=1..12)
day = Slider(1, range=1..30)
x_position = Slider(30, range=30..130)
y_position = Slider(30, range=30..190)
advpart_2 = Wasp_AdvancedPart(
    NAME="2PER",
    GEO=data,
    CONN=flatten([conndir_4.CONN, conndir_8.CONN, conndir_5.CONN, conndir_7.CONN]),
    ATTR=flatten(attribute_3))  # -> PART; inputs GEO: Mesh, CONN: list, HI: list, ATTR: list, SUP: list, AEC: list, OC: list; plug-in component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
advpart_3 = Wasp_AdvancedPart(NAME="4PER", GEO=brep_4, CONN=flatten([conndir_9.CONN, conndir_6.CONN, conndir_10.CONN]), ATTR=flatten(attribute_4))  # -> PART; inputs GEO: Mesh, CONN: list, HI: list, ATTR: list, SUP: list, AEC: list, OC: list; plug-in component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
advpart_4 = Wasp_AdvancedPart(NAME="COL", GEO=part_j_geom, CONN=flatten(conndir_3.CONN), ATTR=flatten(attribute_2))  # -> PART; inputs GEO: Mesh, CONN: list, HI: list, ATTR: list, SUP: list, AEC: list, OC: list; plug-in component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
conndir_12 = Wasp_ConnectionFromDirection(GEO=part_h_geom, CEN=pt, UP=crv, T="COM-SID")  # -> CONN, PLN_OUT; inputs CEN: list of Point3d, UP: list of Curve, T: list; plug-in component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
conndir_13 = Wasp_ConnectionFromDirection(GEO=part_h_geom, CEN=pt_2, UP=crv_2, T="COM-BOT")  # -> CONN, PLN_OUT; inputs CEN: list of Point3d, UP: list of Curve, T: list; plug-in component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
advpart_5 = Wasp_AdvancedPart(NAME="ST", GEO=part_h_geom_2, CONN=flatten(conndir_11.CONN), ATTR=flatten(attribute_6))  # -> PART; inputs GEO: Mesh, CONN: list, HI: list, ATTR: list, SUP: list, AEC: list, OC: list; plug-in component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

# ---- group: Run Me!
toggle = BooleanToggle(True)

# ----
month_2 = GetNumber(month, AtLeast=1, AtMost=2147483647, Maximum=1.797693135e+308, Minimum=-1.797693135e+308)
resolution = GetNumber(Slider(5, range=1..5), AtLeast=1, AtMost=2147483647, Maximum=1.797693135e+308, Minimum=-1.797693135e+308)
day_2 = GetNumber(day, AtLeast=1, AtMost=2147483647, Maximum=1.797693135e+308, Minimum=-1.797693135e+308)
parts = GetNumber(Slider(82, range=1..300), AtLeast=1, AtMost=2147483647, Maximum=1.797693135e+308, Minimum=-1.797693135e+308)
seed = GetNumber(seed_reset, AtLeast=1, AtMost=2147483647, Maximum=1.797693135e+308, Minimum=-1.797693135e+308)
x_position_2 = GetNumber(x_position, AtLeast=1, AtMost=2147483647, Maximum=1.797693135e+308, Minimum=-1.797693135e+308)
y_position_2 = GetNumber(y_position, AtLeast=1, AtMost=2147483647, Maximum=1.797693135e+308, Minimum=-1.797693135e+308)
start_hour_2 = GetNumber(start_hour, AtLeast=1, AtMost=2147483647, Maximum=1.797693135e+308, Minimum=-1.797693135e+308)
legend = GetNumber(Slider(11, range=0..25), AtLeast=1, AtMost=2147483647, Maximum=1.797693135e+308, Minimum=-1.797693135e+308)
end_hour_2 = GetNumber(end_hour, AtLeast=1, AtMost=2147483647, Maximum=1.797693135e+308, Minimum=-1.797693135e+308)
collider = Wasp_Collider(GEO=brep_2)  # -> COLL; inputs GEO: list of Mesh, MUL: Boolean, ALL: Boolean, CONN: list; plug-in component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
advpart_6 = Wasp_AdvancedPart(NAME="COM", GEO=part_h_geom, CONN=flatten([conndir_12.CONN, conndir_13.CONN]), COLL=collider, ATTR=flatten(attribute_5))  # -> PART; inputs GEO: Mesh, CONN: list, HI: list, ATTR: list, SUP: list, AEC: list, OC: list; plug-in component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
# COMMUNAL PARTS
# PART C  //  NOD
# + PART DEFINITION
part_h_geom_3 = Geometry(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)
pt_13 = Point(Point(-2500.655065, -42.14469244, 2.85))
crv_13 = Curve(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)
crv_14 = Curve(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)
pt_14 = Point(Point(-2500.655065, -42.14469244, 1.8))
# PART E  // H CONNECTOR
# + PART DEFINITION
part_j_geom_2 = Geometry(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)
# PART D  // V CONNECTOR
# + PART DEFINITION
part_h_geom_4 = Geometry(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)
crv_15 = Curve(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)
pt_15 = Point(Point(-2466.09255, -75.73048769, 7.2))
conndir_14 = Wasp_ConnectionFromDirection(GEO=part_h_geom_3, CEN=pt_13, UP=crv_13, T="NOD-TOP")  # -> CONN, PLN_OUT; inputs CEN: list of Point3d, UP: list of Curve, T: list; plug-in component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
conndir_15 = Wasp_ConnectionFromDirection(GEO=part_h_geom_3, CEN=pt_14, UP=crv_14, T="NOD-BOT")  # -> CONN, PLN_OUT; inputs CEN: list of Point3d, UP: list of Curve, T: list; plug-in component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
pt_16 = Point([Point(-2467.14255, -75.73048769, 6.15), Point(-2466.09255, -76.78048769, 6.15), Point(-2465.04255, -75.73048769, 6.15), Point(-2466.09255, -74.68048769, 6.15)])
crv_16 = Curve([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])
pt_17 = Point([Point(-2467.14255, -75.73048769, -6.15), Point(-2466.09255, -76.78048769, -6.15), Point(-2465.04255, -75.73048769, -6.15), Point(-2466.09255, -74.68048769, -6.15)])
crv_17 = Curve([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])
crv_18 = Curve(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)
pt_18 = Point(Point(-2466.09255, -75.73048769, -7.2))
attribute_7 = Wasp_Attribute(ID="LADYBUG", VAL=part_h_geom_3, TR=Toggle(True))  # -> ATTR; inputs VAL: list, TR: Boolean; plug-in component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
pt_19 = Point([Point(-2478.564756, -75.73048769, 1.05), Point(-2485.464756, -75.73048769, 1.05)])
curve_2 = Curve([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])
crv_19 = Curve(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)
pt_20 = Point([Point(-2480.914756, -75.73048769, -1.05), Point(-2478.564756, -75.73048769, -1.05), Point(-2485.464756, -75.73048769, -1.05)])
crv_20 = Curve([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])
pt_21 = Point([Point(-2485.464756, -76.78048769, 0), Point(-2485.464756, -74.68048769, 0)])
crv_21 = Curve([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])
crv_22 = Curve([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])
pt_22 = Point([Point(-2477.514756, -75.73048769, 0), Point(-2486.514756, -75.73048769, 0)])
pt_23 = Point(Point(-2483.114756, -75.73048769, 1.05))
conndir_16 = Wasp_ConnectionFromDirection(GEO=part_h_geom_4, CEN=pt_15, UP=crv_15, T="VCON-TOP")  # -> CONN, PLN_OUT; inputs CEN: list of Point3d, UP: list of Curve, T: list; plug-in component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
conndir_17 = Wasp_ConnectionFromDirection(GEO=part_h_geom_4, CEN=pt_18, UP=crv_18, T="VCON-BOT")  # -> CONN, PLN_OUT; inputs CEN: list of Point3d, UP: list of Curve, T: list; plug-in component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
conndir_18 = Wasp_ConnectionFromDirection(GEO=part_h_geom_4, CEN=pt_16, UP=crv_16, T="VCON-SID")  # -> CONN, PLN_OUT; inputs CEN: list of Point3d, UP: list of Curve, T: list; plug-in component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
conndir_19 = Wasp_ConnectionFromDirection(GEO=part_h_geom_4, CEN=pt_17, UP=crv_17, T="VCON-PER")  # -> CONN, PLN_OUT; inputs CEN: list of Point3d, UP: list of Curve, T: list; plug-in component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
unit_z = UnitZ(Factor=1)
attribute_8 = Wasp_Attribute(ID="LADYBUG", VAL=part_h_geom_4, TR=Toggle(True))  # -> ATTR; inputs VAL: list, TR: Boolean; plug-in component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
conndir_20 = Wasp_ConnectionFromDirection(GEO=part_j_geom_2, CEN=pt_23, UP=crv_19, T="HCON-ST")  # -> CONN, PLN_OUT; inputs CEN: list of Point3d, UP: list of Curve, T: list; plug-in component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
conndir_21 = Wasp_ConnectionFromDirection(GEO=part_j_geom_2, CEN=pt_21, UP=crv_22, T="HCON-SID")  # -> CONN, PLN_OUT; inputs CEN: list of Point3d, UP: list of Curve, T: list; plug-in component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
conndir_22 = Wasp_ConnectionFromDirection(GEO=part_j_geom_2, CEN=pt_22, UP=crv_20, T="HCON-FRO")  # -> CONN, PLN_OUT; inputs CEN: list of Point3d, UP: list of Curve, T: list; plug-in component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
conndir_23 = Wasp_ConnectionFromDirection(GEO=part_j_geom_2, CEN=pt_19, UP=curve_2, T="HCON-TOP")  # -> CONN, PLN_OUT; inputs CEN: list of Point3d, UP: list of Curve, T: list; plug-in component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
conndir_24 = Wasp_ConnectionFromDirection(GEO=part_j_geom_2, CEN=pt_20, UP=crv_21, T="HCON-BOT")  # -> CONN, PLN_OUT; inputs CEN: list of Point3d, UP: list of Curve, T: list; plug-in component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
attribute_9 = Wasp_Attribute(ID="LADYBUG", VAL=part_j_geom_2, TR=Toggle(True))  # -> ATTR; inputs VAL: list, TR: Boolean; plug-in component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
part = Wasp_BasicPart(NAME="NOD", GEO=part_h_geom_3, CONN=flatten([conndir_14.CONN, conndir_15.CONN]), ATTR=flatten(attribute_7))  # -> PART; inputs GEO: Mesh, CONN: list, ATTR: list; plug-in component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
mesh = Mesh(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)
contour = Contour(Shape=mesh, Point=Point(0, 0, 0), Direction=unit_z, Distance=Slider(0.984, range=0.1..4))  # -> flatten(Contours)
advpart_7 = Wasp_AdvancedPart(
    NAME="VCON",
    GEO=part_h_geom_4,
    CONN=flatten([conndir_16.CONN, conndir_17.CONN, conndir_18.CONN, conndir_19.CONN]),
    ATTR=flatten(attribute_8))  # -> PART; inputs GEO: Mesh, CONN: list, HI: list, ATTR: list, SUP: list, AEC: list, OC: list; plug-in component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
construct_point = ConstructPoint(XCoordinate=x_position_2, YCoordinate=y_position_2, ZCoordinate=0)
advpart_8 = Wasp_AdvancedPart(
    NAME="HCON",
    GEO=part_j_geom_2,
    CONN=flatten([conndir_23.CONN, conndir_24.CONN, conndir_21.CONN, conndir_22.CONN, conndir_20.CONN]),
    ATTR=flatten(attribute_9))  # -> PART; inputs GEO: Mesh, CONN: list, HI: list, ATTR: list, SUP: list, AEC: list, OC: list; plug-in component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
fillet = Fillet(Curve=contour, Radius=Slider(12.8, range=0.1..20))
unit_z_2 = UnitZ(Factor=Slider(1, range=1..10))
curve_3 = Curve(fillet)
move = Move(Geometry=curve_3, Motion=unit_z_2)  # -> Geometry, Transform
panel = Panel("""TRUE
FALSE
FALSE""")
cull_pattern = CullPattern(List=move.Geometry, CullPattern=invert(panel))
cull_pattern_2 = CullPattern(List=move.Geometry, CullPattern=panel)
dash_pattern = DashPattern(Curve=cull_pattern_2, Pattern=Slider(1.9, range=0.1..5))  # -> Dashes, Gaps
curve_4 = Curve(cull_pattern)

panel_2 = Panel("http://climate.onebuilding.org/WMO_Region_4_North_and_Central_America/USA_United_States_of_America/WI_Wisconsin/USA_WI_Madison-Dane.County.Rgnl.AP-Truax.Field.726410_TMY3.zip")
downloadepw = LBDownloadWeather(weather_URL=panel_2)  # -> epw_file, stat_file, ddy_file; plug-in component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
importloc = LBImportLocation(epw_file=downloadepw.epw_file)  # -> location; plug-in component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

mesh_weldvertices = MeshWeldVertices(Mesh=mesh, Tolerance=0.01)  # -> RuntimeMessage, Mesh
quad_remesh = QuadRemesh(Mesh=mesh, Settings={aqc=True, as=50, dhe=True, gci=0, null=False, pme=0, sa=0, tqc=2000})
analysisperiod = LBAnalysisPeriod(start_month=month_2, start_day=day_2, start_hour=start_hour_2, end_month=month_2, end_day=day_2, end_hour=end_hour_2)  # -> period, hoys, dates; plug-in component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
mesh_edges = MeshEdges(Mesh=mesh_weldvertices.Mesh)  # -> NakedEdges, InteriorEdges, NonManifoldEdges
colrange = LBColorRange(index=legend)  # -> colors; plug-in component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
mcomp = Decompose(Mesh=quad_remesh)  # -> Vertices, Faces, Colours, Normals
join_curves = JoinCurves(Curves=mesh_edges.NakedEdges, Preserve=False)
pcomp = Decompose(Point=mcomp.Vertices)  # -> XComponent, YComponent, ZComponent
legendpar = LBLegendParameters(colors=colrange)  # -> leg_par; plug-in component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
bnd = Bounds(Numbers=pcomp.ZComponent)
divide_curve = DivideCurve(Curve=join_curves, Count=Slider(358, range=1..400), Kinks=False)  # -> Points, Tangents, Parameters
remap = RemapNumbers(Value=pcomp.ZComponent, Source=bnd, Target=Domain(0, 1))  # -> Mapped, Clipped
unit_z_3 = UnitZ(Factor=Slider(6, range=1..30))
polyline = PolyLine(Vertices=divide_curve.Points, Closed=True)
gradient = Gradient(
    LowerLimit=Slider(0, range=0..50),
    UpperLimit=Slider(50, range=0..50),
    Parameter=pcomp.ZComponent,
    stops=[0: RGB(255, 192, 203), 0.89: RGB(255, 255, 255)])
negative = Negative(Value=unit_z_3)
curve_5 = Curve(polyline)
extrude = Extrude(Base=curve_5, Direction=negative)
mesh_brep = MeshBrep(
    Brep=extrude,
    Settings={GridMaxCount=0, GridMinCount=16, JaggedSeams=False, MaxEdgeLength=0, MinEdgeLength=0.0001, MinTolerance=0, Refine=True, RefineAngle=0, RelativeTolerance=0.65, SimplePlanes=True, Tolerance=0})
colour_swatch = ColourSwatch(SwatchColor=RGB(105, 105, 105))
mesh_colours = MeshColours(Mesh=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, Colours=RGB(105, 105, 105))
mesh_2 = Mesh(
    Vertices=[Point(0, 0, 0), Point(0, 219, 42.69452667), Point(153, 219, 47.22606659), Point(153, 0, 2.671763182), Point(153, 123.2919922, 29.09300232), Point(4.561498642, 0, 0.6970229149)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],
    Faces=[{A=0, B=5, C=6, D=7}, {A=1, B=8, C=9, D=10}, {A=2, B=11, C=12, D=13}, {A=3, B=14, C=15, D=16}, {A=4, B=17, C=18, D=19}, {A=2100, B=2090, C=20, D=21}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],
    Colours=[RGB(255, 192, 203), RGB(255, 255, 255), RGB(255, 255, 255), RGB(255, 193, 203), RGB(255, 238, 241), RGB(255, 192, 203)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])

# ---- group: RH_OUT:curve
curve_6 = Curve([dash_pattern.Dashes, curve_4])

# ---- group: RH_OUT:meshtop
mesh_3 = Mesh(mesh_2)

# ---- group: RH_OUT:meshedge
mesh_4 = Mesh(mesh_colours)

# ----
parts_2 = Entwine(
    Branch00=advpart_3,
    Branch01=advpart_2,
    Branch02=part,
    Branch03=advpart_7,
    Branch04=advpart_8,
    Branch05=advpart_4,
    Branch06=advpart_6,
    Branch07=advpart_5,
    Branch08=advpart,
    FlattenInputs=True)  # -> flatten(Result)
parts_3 = Data(parts_2)

connection_rule = Panel("""NOD-TOP>COM-BOT
COM-SID>HCON-FRO
NOD-TOP>VCON-BOT
VCON-SID>HCON-FRO
HCON-FRO>VCON-SID
HCON-SID>4PER-FRO
HCON-SID>2PER-FRO
HCON-FRO>HCON-FRO
HCON-TOP>2PER_V-FRO
HCON-FRO>4PER-FRO
4PER-SID>2PER-SID
HCON-BOT>COL-TOP
2PER-STR>ST-FRO
2PER-SID>2PER-FRO
2PER_V-SID>ST-FRO""")

# ----
# RULES
rulegen = Wasp_RulesGenerator(PART=parts_3, GR=connection_rule)  # -> flatten(R); inputs PART: list, SELF_P: Boolean, SELF_C: Boolean, TYP: Boolean, GR: list; plug-in component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

rules = Data(rulegen)

neigh_b = Point([Point(48.43855017, 109.7120357, 0), Point(102.5220059, 88.12602372, 0)])
mesh_5 = Mesh(mesh)
Z = UnitZ(Factor=1)
project = ProjectPoint(Point=neigh_b, Direction=Z, Geometry=mesh_5)  # -> Point, Index
pt_24 = Point(flatten(project.Point))
lng = ListLength(List=flatten(pt_24))
Z_2 = UnitZ(Factor=Slider(4, range=1..30))
move_2 = Move(Geometry=pt_24, Motion=Z_2)  # -> Geometry, Transform

negative_2 = Negative(Value=Z)

center = Point(construct_point)
Z_3 = UnitZ(Factor=1)
project_2 = ProjectPoint(Point=center, Direction=Z_3, Geometry=mesh_5)  # -> Point, Index
center_2 = Point(project_2.Point)
Z_4 = UnitZ(Factor="80")
series = Series(Start=0, Step="4.2", Count="60")
Z_5 = UnitZ(Factor=series)
neg = Negative(Value=Z_5)
Z_6 = UnitZ(Factor="3")
neg_2 = Negative(Value=Z_6)

sunpath = LBSunPath(north="20", location=importloc, hoys=analysisperiod.hoys, center_pt=center_2, scale=1)  # -> report, vectors, altitudes, azimuths, hoys, sun_pts, analemma, daily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; plug-in component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

repeat = RepeatData(Data=center_2, Length=lng)
ln = Line(StartPoint=move_2.Geometry, EndPoint=repeat)  # -> simplify(graft(Line))
flip = FlipCurve(Curve=ln)  # -> Curve, Flag
eval = EvaluateCurve(Curve=reparameterize(flip.Curve), Parameter=Slider(0.3, range=0..1))  # -> Point, Tangent, Angle

project_3 = Project(Geometry=flatten([center_2, eval.Point]), Plane=center_2)  # -> Geometry, Transform
move_3 = Move(Geometry=project_3.Geometry, Motion=Z_4)  # -> Geometry, Transform
move_4 = Move(Geometry=graft(move_3.Geometry), Motion=neg)  # -> Geometry, Transform
project_4 = ProjectPoint(Point=move_3.Geometry, Direction=negative_2, Geometry=mesh_5)  # -> Point, Index
cps = ClosestPoints(Point=graft(project_4.Point), Cloud=move_4.Geometry, Count="1")  # -> ClosestPoint, CPIndex, Distance
move_5 = Move(Geometry=cps.ClosestPoint, Motion=neg_2)  # -> simplify(Geometry), Transform

center_3 = Center(Geometry=part_h_geom_3, referenceAll=2)  # -> Center, Dimension
pt_25 = Point(move_5.Geometry)
orient = Orient(Geometry=part_h_geom_3, Source=center_3.Center, Target=pt_25)  # -> Geometry, Transform
Z_7 = UnitZ(Factor=1)
line = LineSDL(Start=graft(center_2), Direction=Z_7, Length=Slider(59.4, range=0..1000))
M = MarkerDimension(Line=line, Text=graft("// LUNARC 2024"), Size=Slider(3, range=1..30))

end_points = EndPoints(Curve=line)  # -> Start, End

# ----
# STARTING POINT
parttr = Wasp_TransformPart(PART=part, TR=orient.Transform)  # -> flatten(PART_OUT); plug-in component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

text_tag = TextTag(Location=end_points.End, Text="// LUNARC 2024")
stochasticaggregation = Wasp_StochasticAggregation(PART=flatten(parts_3), PREV=parttr, N=parts, RULES=rules, MODE="3", RESET=seed)  # -> AGGR, PART_OUT; inputs PART: list, PREV: list, N: Int32, RULES: list, SEED: Int32, MODE: Int32, GC: list, RESET: Boolean; plug-in component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
getattr = Wasp_GetAttributeByName(PART=stochasticaggregation.PART_OUT, ID="LADYBUG")  # -> VAL; plug-in component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

directsunhours = LBDirectSunHours(
    vectors=flatten(sunpath.vectors),
    geometry=flatten(getattr),
    context=flatten(mesh),
    grid_size=resolution,
    offset_dist="0.1",
    legend_par=legendpar,
    run=toggle)  # -> report, points, results, mesh, legend, title, int_mtx; plug-in component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

# ---- group: RH_OUT:mesh
mesh_6 = Mesh(directsunhours.mesh)
