# Grasshopper definition test.gh (Grasshopper 1.0.7)
# plug-ins: MeshEdit Components

y_position = Slider(60, range=1..210)
x_position = Slider(71, range=1..150)
curve = Curve([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])
mesh = Mesh(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)
x_position_2 = GetNumber(x_position, AtLeast=1, AtMost=2147483647, Maximum=1.797693135e+308, Minimum=-1.797693135e+308)
y_position_2 = GetNumber(y_position, AtLeast=1, AtMost=2147483647, Maximum=1.797693135e+308, Minimum=-1.797693135e+308)
panel = Panel("""TRUE
FALSE
FALSE""")
construct_point = ConstructPoint(XCoordinate=x_position_2, YCoordinate=y_position_2, ZCoordinate=0)
unit_z = UnitZ(Factor=1)
cull_pattern = CullPattern(List=curve, CullPattern=invert(panel))
cull_pattern_2 = CullPattern(List=curve, CullPattern=panel)
project_point = ProjectPoint(Point=construct_point, Direction=unit_z, Geometry=mesh)  # -> Point, Index
dash_pattern = DashPattern(Curve=cull_pattern_2, Pattern=Slider(1.9, range=0.1..5))  # -> Dashes, Gaps
curve_2 = Curve(cull_pattern)
mesh_sphere_ex = MeshSphereEx(Base=project_point.Point, Radius=10, Count=5)
sphere = Sphere(Base=project_point.Point, Radius=Slider(13, range=1..40))
mesh_flip = MeshFlip(Mesh=mesh_sphere_ex)
flip = Flip(Surface=sphere)  # -> Surface, Result
mesh_colours = MeshColours(Mesh=mesh_sphere_ex, Colours=ColourSwatch(SwatchColor=RGB(255, 125, 125)))
mesh_colours_2 = MeshColours(Mesh=mesh, Colours=ColourSwatch(SwatchColor=RGB(255, 212, 212)))
panel_2 = Panel("https://www.energyplus.net/weather-download/africa_wmo_region_1/ZAF//ZAF_Johannesburg.683680_IWEC/all")
downloadepw = LBDownloadWeather(weather_URL=panel_2)  # -> epw_file, stat_file, ddy_file; plug-in component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
importepw = LBImportEPW(epw_file=downloadepw.epw_file)  # -> location, dry_bulb_temperature, dew_point_temperature, relative_humidity, wind_speed, wind_direction, direct_normal_rad, diffuse_horizontal_rad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; plug-in component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
analysisperiod = LBAnalysisPeriod(
    start_month=Slider(1, range=0..10),
    start_day=Slider(10, range=0..100),
    start_hour=Slider(1, range=0..24),
    end_month=Slider(1, range=0..12),
    end_day=Slider(10, range=0..100),
    end_hour=Slider(23, range=0..100))  # -> period, hoys, dates; plug-in component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
skymatrix = LBCumulativeSkyMatrix(
    location=importepw.location,
    direct_rad=importepw.direct_normal_rad,
    diffuse_rad=importepw.diffuse_horizontal_rad,
    hoys=analysisperiod.hoys)  # -> out, sky_mtx; plug-in component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
sunpath = LBSunPath(
    location=importepw.location,
    hoys=analysisperiod.hoys,
    center_pt=project_point.Point,
    scale=1,
    daily=Toggle(True),
    data=importepw.dry_bulb_temperature)  # -> out, vectors, altitudes, azimuths, hoys, sun_pts, analemma, daily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; plug-in component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

split = TextSplit(Text=sunpath.color_pts, Separators=" ")
join = TextJoin(Text=split)  # -> flatten(Result)
sph = Sphere(Base=sunpath.sun_pts, Radius=Slider(3.7, range=0.1..4))
preview = CustomPreview(Geometry=sph, Material=join)

toggle = BooleanToggle(True)
incidentradiation = LBIncidentRadiation(
    sky_mtx=skymatrix.sky_mtx,
    geometry=flatten(sphere),
    context=flatten(mesh),
    grid_size=Slider(4, range=0..100),
    offset_dist=Slider(0.313, range=0..4),
    parallel=toggle,
    run=toggle)  # -> out, points, results, total, mesh, legend, title, int_mtx; plug-in component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
curve_3 = Curve(sunpath.daily)

# ---- group: RH_OUT:curve
curve_4 = Curve([dash_pattern.Dashes, curve_2, curve_3])

# ---- group: RH_OUT:mesh
mesh_2 = Mesh([mesh_colours, mesh_colours_2])

# ---- group: RH_OUT:analysis
mesh_3 = Mesh(incidentradiation.mesh)
