# Grasshopper definition twisted_tower.gh (Grasshopper 1.0.7)

cluster = Cluster()

# ---- group: RH_IN:Lenght
lenght = Slider(60, range=10..100)

# ---- group: RH_IN:Width
width = Slider(48, range=10..100)

# ---- group: RH_IN:f2f
f2f = Slider(3, range=3..7)

# ---- group: RH_IN:floors
floors = Slider(30, range=1..30)

# ---- group: RH_IN:rotat
rotation = Slider(-37, range=-90..90)

# ----
floor_thck = Slider(0.3, range=0.1..1.1)
column_radius = Slider(0.3, range=0.1..1.1)
length = GetNumber(lenght, AtLeast=1, AtMost=2147483647, Maximum=1.797693135e+308, Minimum=-1.797693135e+308)
floor_heigth = GetNumber(f2f, AtLeast=1, AtMost=2147483647, Maximum=1.797693135e+308, Minimum=-1.797693135e+308)
floors_2 = GetNumber(floors, AtLeast=1, AtMost=2147483647, Maximum=1.797693135e+308, Minimum=-1.797693135e+308)
rotation_2 = GetNumber(rotation, AtLeast=1, AtMost=2147483647, Maximum=1.797693135e+308, Minimum=-1.797693135e+308)
width_2 = GetNumber(width, AtLeast=1, AtMost=2147483647, Maximum=1.797693135e+308, Minimum=-1.797693135e+308)
pt = ConstructPoint(XCoordinate=0, YCoordinate=0, ZCoordinate=0)
rectangle = Rectangle(Plane=pt, XSize=length, YSize=width_2, Radius=0)  # -> Rectangle, Length
series = Series(Start=0, Step=floor_heigth, Count=floors_2)
Z = UnitZ(Factor=series)
move = Move(Geometry=rectangle.Rectangle, Motion=Z)  # -> Geometry, Transform
area = Area(Geometry=move.Geometry)  # -> Area, Centroid
lng = ListLength(List=move.Geometry)  # -> expr("X-1", Length)
dom = ConstructDomain(DomainStart=0, DomainEnd=rotation_2)
range = Range(Domain=dom, Steps=lng)
neg = Negative(Value=Slider(2, range=0..30))
rotate = Rotate(Geometry=move.Geometry, Angle=degrees(range), Plane=area.Centroid)  # -> Geometry, Transform
crv = Curve(rotate.Geometry)
cull_i = CullIndex(List=crv, Indices="-1", Wrap=True)
area_2 = Area(Geometry=cull_i)  # -> Area, Centroid
offset = OffsetCurve(Curve=cull_i, Distance=neg, Plane=area_2.Centroid, Corners=1)
explode = Explode(Curve=offset, Recursive=True)  # -> simplify(Segments), Vertices
len = Length(Curve=explode.Segments)
division = Division(A=len, B=Slider(12, range=1..30))

cull_i_2 = CullIndex(List=crv, Indices="-1", Wrap=True)
area_3 = Area(Geometry=cull_i_2)  # -> Area, Centroid
neg_2 = Negative(Value=Slider(1.6, range=0..5))
offset_2 = OffsetCurve(Curve=cull_i_2, Distance=neg_2, Plane=area_3.Centroid, Corners=1)
subtraction = Subtraction(A=floor_heigth, B=floor_thck)
Z_2 = UnitZ(Factor=subtraction)
extr = Extrude(Base=offset_2, Direction=Z_2)

cull_i_3 = CullIndex(List=crv, Indices="-1", Wrap=True)
divide = DivideCurve(Curve=reparameterize(explode.Segments), Count=division, Kinks=False)  # -> simplify(Points), Tangents, Parameters
area_4 = Area(Geometry=cull_i_3)  # -> Area, Centroid
neg_3 = Negative(Value=Slider(9.1, range=0..30))
trim = TrimTree(Tree=divide.Points, Depth=1)
offset_3 = OffsetCurve(Curve=cull_i_3, Distance=neg_3, Plane=area_4.Centroid, Corners=1)
flip = FlipMatrix(Data=trim)

Z_3 = UnitZ(Factor=floor_thck)
neg_4 = Negative(Value=Z_3)
extr_2 = Extrude(Base=crv, Direction=neg_4)
cap = CapHoles(Brep=extr_2)

subtraction_2 = Subtraction(A=floor_heigth, B=floor_thck)
Z_4 = UnitZ(Factor=subtraction_2)
pline = PolyLine(Vertices=flip, Closed=False)  # -> flatten(Polyline)
pipe = Pipe(Curve=pline, Radius=column_radius, Caps=0)
extr_3 = Extrude(Base=offset_3, Direction=Z_4)
mesh = MeshBrep(
    Brep=pipe,
    Settings={GridMaxCount=0, GridMinCount=16, JaggedSeams=False, MaxEdgeLength=0, MinEdgeLength=0.0001, MinTolerance=0, Refine=True, RefineAngle=0, RelativeTolerance=0.65, SimplePlanes=True, Tolerance=0})
mesh_2 = MeshBrep(
    Brep=extr_3,
    Settings={GridMaxCount=0, GridMinCount=16, JaggedSeams=False, MaxEdgeLength=0, MinEdgeLength=0.0001, MinTolerance=0, Refine=True, RefineAngle=0, RelativeTolerance=0.65, SimplePlanes=True, Tolerance=0})
mesh_3 = MeshBrep(
    Brep=extr,
    Settings={GridMaxCount=0, GridMinCount=16, JaggedSeams=False, MaxEdgeLength=0, MinEdgeLength=0.0001, MinTolerance=0, Refine=True, RefineAngle=0, RelativeTolerance=0.65, SimplePlanes=True, Tolerance=0})
mesh_4 = MeshBrep(
    Brep=cap,
    Settings={GridMaxCount=0, GridMinCount=16, JaggedSeams=False, MaxEdgeLength=0, MinEdgeLength=0.0001, MinTolerance=0, Refine=True, RefineAngle=0, RelativeTolerance=0.65, SimplePlanes=True, Tolerance=0})
mjoin = MeshJoin(Meshes=flatten([mesh_4, mesh_3, mesh_2, mesh]))
c_script = CSharpScript(mesh=flatten(mjoin))  # -> base64Draco; inputs mesh: Mesh
# ---------- c_script: C# ----------
    var options = new Rhino.FileIO.DracoCompressionOptions();
    options.CompressionLevel = 5;
    options.IncludeTextureCoordinates = false;
    options.IncludeVertexColors = false;

    var compressed = Rhino.FileIO.DracoCompression.Compress(mesh, options);
    base64Draco = compressed.ToBase64String();
# ---------- end c_script ----------
mjoin_2 = MeshJoin(Meshes=flatten([mesh_4, mesh_3, mesh_2, mesh]))
preview = CustomPreview(Geometry=flatten(mjoin_2), Material=ColourSwatch(SwatchColor=RGB(255, 20, 20)))

# ---- group: RH_OUT:Mesh
txt = Text(c_script)

# ==== cluster Cluster
